# Grasshopper definition Slice.ghx (Grasshopper 1.0.7)

panel = Panel("積層高さは、0.027mm で良い")
panel_2 = Panel("0.027")
panel_3 = Panel("C:\Users\ysoky\Documents\Digital_Artisan\Stratasys_Print_Prepare")
mesh = Mesh(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)
brep = Brep(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)
panel_4 = Panel("""300 dpi
450 px = 1.5 inch = 38.1 mm""")
python = GhPythonScript(x=panel_3)  # -> out
# ---------- python: Python ----------
import sys

sys.path.append(x)
print(sys.path)
# ---------- end python ----------
merge = Merge(Data1=mesh, Data2=brep)
panel_5 = Panel(python)
python_2 = GhPythonScript(WHD="38.1", LAYER_HEIGHT="1", TARGET=merge, GEOMETRY_INDEX="0")  # -> out, slice_count, OUTPUT; inputs TARGET: list
# ---------- python_2: Python ----------
import Rhino
import Rhino.Geometry as rg
import rhinoscriptsyntax as rs
import scriptcontext as sc

from prepare_operate_geometry import bake_geometry, create_geometry, rs_command

reload(bake_geometry)
reload(create_geometry)
reload(rs_command)

bg = bake_geometry.Bake_Geometry()
cg = create_geometry.Create_Geometry()
cmd = rs_command.rs_Command()


def test_int():
    
    for i in xrange(20):
        val = i * 0.1
        print("{} : {}".format(val, int(val)))


def capture_image_size(file_name, ww, hh):
    query = "-ViewCaptureToFile W={} H={} S=1 D=_No R=_No A=_No T=_Yes {}" \
        .format(ww, hh, file_name)
        
    rs.Command(query)



def flatten_array(array_):
    
    elms = []
    
    for i in xrange(len(array_)):
        sub = array_[i]
        for j in xrange(len(sub)):
            elms.append(sub[j])

    return elms




def slice_plane(target, plane):
    
    ### Slice
    p = rs.coerceplane(plane)
    # print(p)
    
    ### Geomrtry Type
    if rs.IsMesh(target):
        # print("Mesh!!")
        m = rs.coercemesh(target)
        # print(m)
        polylines = rg.Intersect.Intersection.MeshPlane(m, p)
    
    elif rs.IsBrep(target):
        # print("Brep!")
        b = rs.coercebrep(target)
        mp = rg.MeshingParameters.QualityRenderMesh
        m = rg.Mesh.CreateFromBrep(b, mp)
        # print(m[0])
        polylines = rg.Intersect.Intersection.MeshPlane(m[0], p)
    
    else:
        # print("N/A")
        polylines = None
    
    return polylines


def generate_surface(polylines):
    
    ### Polyline to Surface
    surfaces = []
    
    for i in xrange(len(polylines)):
        
        pl = polylines[i]
        crv = rg.Polyline.ToNurbsCurve(pl)
        p = rg.Brep.CreatePlanarBreps(crv)
        # print(p)
        
        surfaces.append(p[0])
    
    return surfaces


def slice_geometry(geometries, geometry_index, layer_height, print_height):
    
    slice_count = int(print_height / layer_height) + 1
    
    ### Select geometry
    target = geometries[geometry_index]
    # print(target)
    
    ### Slice
    sliced = []
    
    for i in xrange(slice_count):
        
        current_height = layer_height * i
        
        p = rs.MovePlane(rs.WorldXYPlane(), [0, 0, current_height])
        pl = slice_plane(target, p)
        
        if pl != None:
            # print(pl)
            surfaces = generate_surface(pl)
            print(surfaces)
            sliced.append(surfaces)
            
            
    
    return sliced



size_ = float(WHD)
#layer_ = float(LAYER_HEIGHT)
#slice_count = int(size_ / layer_)
#index = int(GEOMETRY_INDEX)


a = cg.create_box(size_)


#OUTPUT = slice_geometry(TARGET, index, layer_, size_)
#dev = flatten_array(OUTPUT)
# ---------- end python_2 ----------
python_3 = GhPythonScript(SIZE="38.1")  # -> RECT, dev
# ---------- python_3: Python ----------
import Rhino.Geometry as rg


from prepare_operate_geometry import create_geometry
reload(create_geometry)
cg = create_geometry.Create_Geometry()

RECT = cg.create_rect(SIZE)
dev = cg.create_box(SIZE)
# ---------- end python_3 ----------
panel_6 = Panel(python_2.slice_count)
preview = CustomPreview(Material={diffuse=RGB(221, 160, 221), emission=RGB(66, 48, 66), shine=0.5, specular=RGB(255, 255, 255), transparency=0})  # disabled
python_4 = GhPythonScript(SIZE="38.1", BOOL=Button())  # -> a
# ---------- python_4: Python ----------
import Rhino
import Rhino.Geometry as rg
import rhinoscriptsyntax as rs
import scriptcontext as sc

from prepare_operate_geometry import bake_geometry, create_geometry, rs_command

reload(bake_geometry)
reload(create_geometry)
reload(rs_command)

bg = bake_geometry.Bake_Geometry()
cg = create_geometry.Create_Geometry()
cmd = rs_command.rs_Command()



dir_path = "C:\\Users\\ysoky\\Documents\\Digital_Artisan\\Stratasys_Print_Prepare\\images\\size\\"
file_name = dir_path + "size.png"


rect_ = cg.create_rect(SIZE)



if BOOL:
    
    bg.bake_breps(ghdoc, rect_)
    cmd.capture_image_size_w_all_option(file_name, 800, 800)
# ---------- end python_4 ----------
panel_7 = Panel(python_3.dev)
panel_8 = Panel(python_4)
dam = DataDam(BufferDelay=10000000, BufferMode=0)
